# Grasshopper definition assign2waffle.gh (Grasshopper 1.0.8)

number_slider = Slider(65, range=0..100)
construct_point = ConstructPoint(XCoordinate=0, YCoordinate=0, ZCoordinate=Slider(32, range=0..100))
multiplication = Multiplication(A=number_slider, B=Slider(4, range=0..10))
construct_point_2 = ConstructPoint(XCoordinate=0, YCoordinate=0, ZCoordinate=number_slider)
cylinder = Cylinder(Base=construct_point, Radius=number_slider, Length=multiplication)
sphere = Sphere(Base=construct_point_2, Radius=number_slider)
cap_holes = CapHoles(Brep=cylinder)
solid_difference = SolidDifference(BrepsA=sphere, BrepsB=cap_holes)
deconstruct_brep = DeconstructBrep(Brep=solid_difference)  # -> Faces, Edges, Vertices
cull_index = CullIndex(List=deconstruct_brep.Faces, Indices=1, Wrap=True)
bounding_box = BoundingBox(Content=cull_index, Plane=PlaneXY(0, 0, 0))  # -> Box, Box_2
range = Range(Domain=Domain(0, 1), Steps=Slider(15, range=-11..15))
range_2 = Range(Domain=Domain(0, 1), Steps=Slider(15, range=0..100))
evaluate_box = EvaluateBox(Box=bounding_box.Box, UParameter=range, VParameter=0.5, WParameter=0.5)  # -> Plane, Point, Include
evaluate_box_2 = EvaluateBox(Box=bounding_box.Box, UParameter=0.5, VParameter=range_2, WParameter=0.5)  # -> Plane, Point, Include
yz_plane = YZPlane(Origin=evaluate_box.Plane)
xz_plane = XZPlane(Origin=evaluate_box_2.Plane)
brep_plane = BrepPlane(Brep=cull_index, Plane=xz_plane)  # -> flatten(Curves), Points
number_slider_2 = Slider(1.3, range=0..2.3)
unit_y = UnitY(Factor=number_slider_2)
negative = Negative(Value=unit_y)
brep_plane_2 = BrepPlane(Brep=cull_index, Plane=yz_plane)  # -> flatten(Curves), Points
merge = Merge(Data1=negative, Data2=unit_y)
move = Move(Geometry=graft(brep_plane.Curves), Motion=merge)  # -> Geometry, Transform
unit_x = UnitX(Factor=number_slider_2)
loft = Loft(Curves=move.Geometry, Options={Adjust=False, Closed=False, LoftEnds=0, LoftSimp=0, LoftType=0, Rebuild=10, Refit=0.01})
negative_2 = Negative(Value=unit_x)
number_slider_3 = Slider(9.3, range=0..10)
merge_2 = Merge(Data1=negative_2, Data2=unit_x)
move_2 = Move(Geometry=graft(brep_plane_2.Curves), Motion=merge_2)  # -> Geometry, Transform
curve_curve = CurveCurve(CurveA=graft(brep_plane_2.Curves), CurveB=brep_plane.Curves)  # -> Points, ParamsA, ParamsB
unit_z = UnitZ(Factor=1)
unit_z_2 = UnitZ(Factor=number_slider_3)
extrude = Extrude(Base=loft, Direction=unit_z_2)
panel = Panel("""0
2
5
9""")
unit_z_3 = UnitZ(Factor=number_slider_3)
loft_2 = Loft(Curves=move_2.Geometry, Options={Adjust=False, Closed=False, LoftEnds=0, LoftSimp=0, LoftType=0, Rebuild=10, Refit=0.01})
line_sdl = LineSDL(Start=curve_curve.Points, Direction=unit_z, Length=number_slider_3)
number_slider_4 = Slider(0.4, range=0..2.3)
construct_domain = ConstructDomain(DomainStart=number_slider_2, DomainEnd=expr("-x", number_slider_2))
extrude_2 = Extrude(Base=loft_2, Direction=unit_z_3)
curve_middle = CurveMiddle(Curve=line_sdl)
rectangle = Rectangle(Plane=curve_middle, XSize=construct_domain, YSize=construct_domain, Radius=0)  # -> Rectangle, Length
scale = Scale(Geometry=line_sdl, Center=curve_middle, Factor=Slider(2, range=0..2))  # -> Geometry, Transform
sub_curve = SubCurve(BaseCurve=reparameterize(scale.Geometry), Domain="0.5 to 1")
sub_curve_2 = SubCurve(BaseCurve=reparameterize(scale.Geometry), Domain="0 to 0.5")
sweep1 = Sweep1(Rail=sub_curve, Sections=rectangle.Rectangle, Miter=1)
sweep1_2 = Sweep1(Rail=sub_curve_2, Sections=rectangle.Rectangle, Miter=1)
fillet_edge = FilletEdge(Shape=extrude_2, Blend=0, Metric=0, Edges=panel, Radii=flatten(number_slider_4))
fillet_edge_2 = FilletEdge(Shape=extrude, Blend=0, Metric=0, Edges=panel, Radii=flatten(number_slider_4))
cap_holes_2 = CapHoles(Brep=sweep1_2)
cap_holes_3 = CapHoles(Brep=sweep1)
solid_difference_2 = SolidDifference(BrepsA=fillet_edge_2, BrepsB=flatten(cap_holes_2))  # disabled
solid_difference_3 = SolidDifference(BrepsA=fillet_edge, BrepsB=flatten(cap_holes_3))  # disabled
